% Simulink data dictionary AEB_Data.sldd

Gravity = Simulink.Parameter(9.81, DataType="half", Unit="m/s^2")
L_Limit = Simulink.Parameter(-1.1, DataType="half")
Min_Dis_Stop_Veh = Simulink.Parameter(2, DataType="uint8", Unit="m")
R_Limit = Simulink.Parameter(1.1, DataType="half")
Out_Rang = Simulink.Parameter(300, DataType="uint16")
On_Value = Simulink.Parameter(1, DataType="uint8")
Obstacle_Longitudinal_Distance = Simulink.Parameter([], DataType="half", Min=0, Max=260, Unit="m")
Obstacle_Lateral_Distance = Simulink.Parameter([], DataType="half", Unit="m")
Reac_Time = Simulink.Parameter(1, DataType="uint8", Unit="Sec")
Friction = Simulink.Parameter(0.7, DataType="half", Min=0, Max=1, Unit="newton")
AEB_Warning = Simulink.Parameter(1)
No_Warning = Simulink.Parameter(0)
AEB_Brake_Apply = Simulink.Parameter(1)
Growth_Time_Dec = Simulink.Parameter(0.1, DataType="half")
Host_Vehicle_Velocity = Simulink.Parameter([], DataType="half", Min=0, Max=240, Unit="kmph")
Obstacle_Velocity = Simulink.Parameter([], DataType="half", Min=0, Max=240, Unit="kmph")